# Dynamo graph FaceAreaToCustomProperty.dyn (Dynamo 1.2.2.373)

code_block = CodeBlock { "面积"; }
select_face = SelectFace()  # 1 picked in the model
area = SldWorksNodes.Brep.Face.Area(select_face)
string_from_object = FromObject(area)
byNameText = SldWorksNodes.CustomProperty.CustomProperty.ByNameText(code_block, string_from_object)
